# Grasshopper definition MeshJoin_Prototype.gh (Grasshopper 0.9.76)

# Step 01: Construct primitive meshes
# Step 02: Join primitive meshes
# Step 03: Create a new list of MeshFaces from the primitives
# Step 04: Convert the MeshFaces to the string equivalent.
# Step 05: Compare the string equivalent of the joined MeshFaces and the ones manually merged.
# Step 06: Get a unique list of results. In this case 'True' indicating that each MeshFace is identical between the two.
msphere = MeshSphere(Base=PlaneXY(20, 0, 0), Radius=10, UCount=10, VCount=20)
# Step
# 01
mbox = MeshBox(Base={Plane=PlaneXY(0, 0, 0), X=Domain(-10, 10), Y=Domain(-10, 10), Z=Domain(-10, 10)}, XCount=10, YCount=10, ZCount=10)
# Step 01: Construct primitive meshes
# Step 02: Join primitive meshes
# Step 03: Deconstruct the joined mesh and the two primitive meshes.
# Step 04: Merge the vertex lists of the two primitives.
# Step 05: Calcualte the distance between the joined mesh vertices and the merge list of primitve vertices
# Step 06: Total all of the distances between vertices.
msphere_2 = MeshSphere(Base=PlaneXY(20, 0, 0), Radius=10, UCount=10, VCount=20)
# Step
# 01
mbox_2 = MeshBox(Base={Plane=PlaneXY(0, 0, 0), X=Domain(-10, 10), Y=Domain(-10, 10), Z=Domain(-10, 10)}, XCount=10, YCount=10, ZCount=10)
# Step
# 02
mjoin = MeshJoin(Meshes=[mbox, msphere])
# Step
# 02
mjoin_2 = MeshJoin(Meshes=[mbox_2, msphere_2])
# Step
# 03
c_script = CSharpScript(joinedMesh=mjoin, boxPrimitive=mbox, spherePrimitive=msphere)  # -> out, joined, merged; inputs joinedMesh: Mesh, boxPrimitive: Mesh, spherePrimitive: Mesh
# ---------- c_script: C# ----------
    // Get a list of the MeshFaces from the joined mesh
    List<MeshFace> joinedFaces = joinedMesh.Faces.ToList();

    // Get lists of the MeshFaces from the primitives.
    List<MeshFace> boxFaces = boxPrimitive.Faces.ToList();
    List<MeshFace> sphereFaces = spherePrimitive.Faces.ToList();

    // Create a new list of MeshFaces and add the boxFaces to the list.
    List<MeshFace> mergedFaces = new List<MeshFace>();
    mergedFaces.AddRange(boxFaces);

    // Iterate through the sphereFaces and add the quantity of vertices from the boxPrimitive mesh
    // to the each index in the meshface. Then add the modified meshface to the mergedFaces list.
    for(int i = 0; i < sphereFaces.Count; i++)
    {
      MeshFace face = sphereFaces[i];
      face.A = face.A + boxPrimitive.Vertices.Count;
      face.B = face.B + boxPrimitive.Vertices.Count;
      face.C = face.C + boxPrimitive.Vertices.Count;

      // If the face is a quad, add the vertex count. Otherwise leave as is.
      if(face.IsQuad)
        face.D = face.D + boxPrimitive.Vertices.Count;

      // Add the modified face to the list
      mergedFaces.Add(face);
    }

    // output the MeshFaces
    joined = joinedFaces;
    merged = mergedFaces;
# ---------- end c_script ----------
# Step
# 03
# Step
# 04
demesh = DeconstructMesh(Mesh=mjoin_2)  # -> Vertices, Faces, Colours, Normals
demesh_2 = DeconstructMesh(Mesh=mbox_2)  # -> Vertices, Faces, Colours, Normals
demesh_3 = DeconstructMesh(Mesh=msphere_2)  # -> Vertices, Faces, Colours, Normals
merge = Merge(Data1=demesh_2.Vertices, Data2=demesh_3.Vertices)
# Step
# 04
txt = Text(c_script.joined)
txt_2 = Text(c_script.merged)
# Step
# 05
dist = Distance(PointA=demesh.Vertices, PointB=merge)
# Step
# 05
tmatch = MatchText(Text=txt, Pattern=txt_2, Case=True)
# Step
# 06
ma = MassAddition(Input=dist)  # -> Result, PartialResults
# Step
# 06
cset = CreateSet(List=tmatch)  # -> Set, Map
panel = Panel(ma.Result)
panel_2 = Panel(cset.Set)
