# Dynamo graph MeshJoin_Test.dyn (Dynamo 1.3.0.875)

# group: MeshToolkit Cuboid Primitive
code_block = CodeBlock { 20; 10; }
cuboid = Autodesk.Dynamo.MeshToolkit.Mesh.Cuboid(arg1=code_block.out0, arg2=code_block.out0, arg3=code_block.out0, arg4=code_block.out1, arg5=code_block.out1, arg6=code_block.out1)

# group: Covnert MeshToolkit Mesh to a Dynamo Mesh
vertices = Autodesk.Dynamo.MeshToolkit.Mesh.Vertices(cuboid)
vertexIndicesByTri = Autodesk.Dynamo.MeshToolkit.Mesh.VertexIndicesByTri(cuboid)
code_block_2 = CodeBlock { 3; }
chop = List.Chop(list=vertexIndicesByTri, lengths=code_block_2)
code_block_3 = CodeBlock { 0; }
getItemAtIndex = List.GetItemAtIndex(list=chop@L2, index=code_block_3)
code_block_4 = CodeBlock { 1; }
getItemAtIndex_2 = List.GetItemAtIndex(list=chop@L2, index=code_block_4)
code_block_5 = CodeBlock { 2; }
getItemAtIndex_3 = List.GetItemAtIndex(list=chop@L2, index=code_block_5)
byIndices = IndexGroup.ByIndices(getItemAtIndex, getItemAtIndex_2, getItemAtIndex_3)
byPointsFaceIndices = Mesh.ByPointsFaceIndices(vertices, byIndices)

# group: MeshToolkit Sphere Primitive
code_block_6 = CodeBlock { 20; }
# note: The MeshToolkit package is necessary for this first step. If it is not installed, please install it to generate the primitive meshes.
byCoordinates = Point.ByCoordinates(x=code_block_6)
code_block_7 = CodeBlock { 10; 20; }
boolean = BoolSelector(false)
sphere = Autodesk.Dynamo.MeshToolkit.Mesh.Sphere(byCoordinates, code_block_7.out0, code_block_7.out1, boolean)

# group: Covnert MeshToolkit Mesh to a Dynamo Mesh
vertices_2 = Autodesk.Dynamo.MeshToolkit.Mesh.Vertices(sphere)
vertexIndicesByTri_2 = Autodesk.Dynamo.MeshToolkit.Mesh.VertexIndicesByTri(sphere)
code_block_8 = CodeBlock { 3; }
chop_2 = List.Chop(list=vertexIndicesByTri_2, lengths=code_block_8)
code_block_9 = CodeBlock { 0; }
getItemAtIndex_4 = List.GetItemAtIndex(list=chop_2@L2, index=code_block_9)
code_block_10 = CodeBlock { 1; }
getItemAtIndex_5 = List.GetItemAtIndex(list=chop_2@L2, index=code_block_10)
code_block_11 = CodeBlock { 2; }
getItemAtIndex_6 = List.GetItemAtIndex(list=chop_2@L2, index=code_block_11)
byIndices_2 = IndexGroup.ByIndices(getItemAtIndex_4, getItemAtIndex_5, getItemAtIndex_6)
byPointsFaceIndices_2 = Mesh.ByPointsFaceIndices(vertices_2, byIndices_2)

combine_meshes_into_a_list = CodeBlock(cuboidMesh=byPointsFaceIndices, sphereMesh=byPointsFaceIndices_2) { {cuboidMesh, sphereMesh}; }

# group: Zero Touch
# note: This node is the one imported as a Zero Touch library, and is based on the github example here:
# https://www.github.com/logant/DynamoExamples
# This library may need to be loaded before this file is opened.
meshJoin = LINE.Dynamo.ZeroTouchDS.Meshes.MeshJoin(combine_meshes_into_a_list)

watch = Watch(meshJoin)
